# Grasshopper definition avaliando_epw.gh (Grasshopper 1.0.7)
# plug-ins: LadybugGrasshopper

panel = Panel("http://climate.onebuilding.org/WMO_Region_3_South_America/BRA_Brazil/BA_Bahia/BRA_BA_Salvador-Magalhaes.Intl.AP.832480_TMYx.zip")
lb_falsestarttoggle = LBFalseStartToggle(False)
epwmap = LBEPWmap(epw_map=lb_falsestarttoggle)  # -> Output; plug-in component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
downloadepw = LBDownloadWeather(weather_URL=panel)  # -> epw_file, stat_file, ddy_file; plug-in component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
importepw = LBImportEPW(epw_file=downloadepw.epw_file)  # -> location, dry_bulb_temperature, dew_point_temperature, relative_humidity, wind_speed, wind_direction, direct_normal_rad, diffuse_horizontal_rad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; plug-in component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
panel_2 = Panel(importepw.model_year)
xdata = LBDeconstructData(data=importepw.model_year)  # -> header, values; plug-in component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
panel_3 = Panel(importepw.location)
xdata_2 = LBDeconstructData(data=importepw.wind_direction)  # -> header, values; plug-in component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
decnstrloc = LBDeconstructLocation(location=importepw.location)  # -> name, latitude, longitude, time_zone, elevation; plug-in component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
panel_4 = Panel(xdata.values)
create_set = CreateSet(List=xdata_2.values)  # -> Set, Map
create_set_2 = CreateSet(List=xdata.values)  # -> Set, Map
list_length = ListLength(List=create_set.Set)
panel_5 = Panel(list_length)
list_length_2 = ListLength(List=create_set_2.Set)
panel_6 = Panel(create_set_2.Set)
sort_list = SortList(Keys=create_set_2.Set)  # -> Keys, ValuesValuesA
panel_7 = Panel(list_length_2)
panel_8 = Panel(sort_list.Keys)
