# Grasshopper definition archicad_connect.gh (Grasshopper 1.0.7)
# plug-ins: Grasshopper-ARCHICAD Live Connection built for Rhinoceros 6

series = Series(Start="0.00", Step=Slider(4.2, range=0.01..10), Count=Slider(3, range=1..50))
xy_plane = XYPlane(Origin=Point(0, 0, 0))
unit_z = UnitZ(Factor=series)
move = Move(Geometry=xy_plane, Motion=unit_z)  # -> Geometry, Transform
story_plane = StoryPlane()
layer = Layer()
number_slider = Slider(10, range=1..50)
slabsetc = SlabSettingsComposite(Layer=layer, Layer_2=layer, AC_ActiveState_Name="Composite")
rectangle = Rectangle(Plane=PlaneXY(0, 0, 0), XSize=number_slider, YSize=number_slider, Radius=0)  # -> Rectangle, Length
panel = Panel(slabsetc)
slab = Slab(Synchronize=Toggle(False), Polygon=rectangle.Rectangle, SlabSettings=slabsetc)
panel_2 = Panel(slab)
